# Grasshopper definition TestArrays.gh (Grasshopper 1.0.7)
# Copyright: Arup
# plug-ins: DataCenters

rectangle = Rectangle(Plane=PlaneXY(0, 0, 0), XSize=Slider(2, range=2..5), YSize=Slider(3.47, range=2..5), Radius=0)  # -> Rectangle, Length
pln = Plane(Plane(origin=(15.08637324, 10.99397053, 0), x=(0.9265343228, 0.3762102452, 0), y=(-0.3762102452, 0.9265343228, 0)))
arrayrect = ArrayRectangles(
    NumX=Slider(4, range=2..10),
    NumY=Slider(7, range=2..10),
    DistanceX=1,
    DistanceY=1,
    Rectangles=rectangle.Rectangle,
    Plane=pln,
    Rotate=Toggle(True))
crv = Curve(arrayrect)
