# Grasshopper definition TestTransformation.gh (Grasshopper 0.9.76)

pt = Point(Point(-9.963426194, 10.96568873, 0))
vec = Vector(Vector(-3.614134723, 3.947284544, 0))
pln = Plane(Plane(origin=(-25.48470441, 3.880701777, 0), x=(0.6889624321, 0.7247970524, 0), y=(-0.7247970524, 0.6889624321, 0)))
pt_2 = Point(vec)
pl = ConstructPlane(Origin=Point(0, 0, 0), XAxis=Vector(1, 0, 0), YAxis=Vector(0, 1, 0))
orient = Orient(Source=pl, Target=pln)  # -> Geometry, Transform
pt_3 = Point(Point(-15.17714648, -8.569973421, 0))
vec_2 = Vector(Vector(-13.35107256, -7.708019224, 0))
vdis = VectorDisplay(Anchor=pt_3, Vector=vec_2)
transform = Transform(Geometry=pt_2, Transform=orient.Transform)
c_script = CSharpScript(V=vec, P=pln, v=vec_2, p=pt_3)  # -> out, A, B; inputs V: Vector3d, P: Plane, v: Vector3d, p: Point3d
# ---------- c_script: C# ----------
    var pl = new Plane(p, v);
    var transformation = Transform.PlaneToPlane(Plane.WorldXY, pl);
    var point = (Point3d) V;
    point.Transform(transformation);
    A = point - P.Origin;
    B = pl;
# ---------- end c_script ----------
pt_4 = Point(transform)
vec2pt = Vector2Pt(PointA=pln, PointB=pt_4, Unitize=False)  # -> Vector, Length
vdis_2 = VectorDisplay(Anchor=pt_3, Vector=c_script.A)
vdis_3 = VectorDisplay(Anchor=pl, Vector=vec)
vdis_4 = VectorDisplay(Anchor=pln, Vector=c_script.A)
