# Grasshopper definition testInscribedCurve.gh (Grasshopper 0.9.76)
# plug-ins: MiscToolbox

crv = Curve(reparameterize(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))
number_slider = Slider(0, range=0..1)
number_slider_2 = Slider(105, range=0..1000)
range = Range(Domain=Domain(0, 1), Steps=number_slider_2)
divide = DivideCurve(Curve=crv, Count=number_slider_2, Kinks=False)  # -> Points, Tangents, Parameters
number_slider_3 = Slider(1000, range=0..1000)
crossref = CrossReference(ListA=divide.Points, ListB=divide.Points, CrossMode=5)  # -> ListA, ListB
ln = Line(StartPoint=crossref.ListA, EndPoint=crossref.ListB)
len = Length(Curve=ln)
sort = SortList(Keys=len, ValuesA=ln)  # -> Keys, reverse(ValuesA)
lng = ListLength(List=sort.ValuesA)
item = ListItem(List=ln, Index=Slider(26, range=0..1000), Wrap=True)
division = Division(A=lng, B=2)
split = SplitList(List=sort.ValuesA, Index=division)  # -> ListA, ListB
crv_2 = Curve(reparameterize(ln))
crv_3 = Curve(graft(item))  # disabled
number_slider_4 = Slider(0, range=0..180)  # disabled
eval = EvaluateCurve(Curve=reparameterize(crv_3), Parameter=Slider(0.5, range=0..1))  # -> Point, Tangent, Angle; disabled
insrect = InscribedRectangle(Boundary=crv, Curve=crv_2)  # -> Curve, Area, Polyline
number_slider_5 = Slider(30, range=0..1000)  # disabled
pi = Pi(Factor=1)  # disabled
c_script = CSharpScript(C=crv_2, B=crv)  # -> out, A, D; inputs C: Curve, B: Curve, d: Double; disabled
# ---------- c_script: C# ----------
    double area = 10;
    D = GetLargestRectangle(C, B, out area);
    A = area;
    //A = RotateCurve(C, -Math.PI/2);
# ---------- c_script: C# additional code ----------
  /// <summary>
  /// https://web.archive.org/web/20120410040052/http://blog.csharphelper.com/2010/01/04/calculate-a-polygons-area-in-c.aspx
  /// https://stackoverflow.com/questions/2034540/calculating-area-of-irregular-polygon-in-c-sharp
  /// </summary>
  /// <param name="points"></param>
  /// <returns></returns>
  public double Area(List<Point3d> points)
  {
    var area = Math.Abs(points.Take(points.Count() - 1)
      .Select((p, i) => (points[i + 1].X - p.X) * (points[i + 1].Y + p.Y))
      .Sum() / 2);
    return area;
  }

  public Curve RotateCurve(Curve StartCurve, double angle)
  {
    var nurb = StartCurve.ToNurbsCurve();
    var transform = Transform.Rotation(angle, Vector3d.ZAxis, StartCurve.PointAt(0.5));
    nurb.Transform(transform);
    return nurb;
  }

  public Curve GetLargestRectangle(Curve StartCurve, Curve Boundary, out double area)
  {
    double step = 1 / 180.0 * Math.PI;
    List<Curve> curves = new List<Curve>();
    for (int i = -90; i < 90; i++)
    {
      var c = RotateCurve(StartCurve, step * i);
      Rhino.Geometry.Intersect.CurveIntersections result =
        Rhino.Geometry.Intersect.Intersection.CurveCurve(Boundary, c, 0.1, 0.1);
      if(!result.Any())
      {
        curves.Add(c);
      }
    }

    double max = 0;
    Curve best = null;
    Polyline polyline = null;
    foreach (Curve curve in curves)
    {
      var points = new List<Point3d>
        { curve.PointAt(0), Boundary.PointAt(0),
          curve.PointAt(1), Boundary.PointAt(1),
          curve.PointAtStart};
      var temp = Area(points);
      if(temp > max)
      {
        max = temp;
        best = curve;
        polyline = new Polyline(points);
      }
    }
    area = max;
    return best;
  }
# ---------- end c_script ----------
item_2 = ListItem(List=c_script.D, Index=number_slider_4, Wrap=True)  # disabled
sort_2 = SortList(Keys=insrect.Area, ValuesA=insrect.Polyline)  # -> Keys, ValuesA
end = EndPoints(Curve=item_2)  # -> Start, End; disabled
end_2 = EndPoints(Curve=crv_2)  # -> Start, End; disabled
panel = Panel([c_script.out, c_script.A, c_script.D])
range_2 = Range(Domain=pi, Steps=number_slider_5)  # disabled
item_3 = ListItem(List=reverse(sort_2.ValuesA), Index=0, Wrap=True)
pt = Point(end.Start)  # disabled
crv_4 = Curve(c_script.D)
rotate = Rotate(Geometry=crv_3, Angle=range_2, Plane=eval.Point)  # -> Geometry, Transform; disabled
merge = Merge(Data1=pt, Data2=end_2.Start, Data3=end.End, Data4=end_2.End)  # disabled
pline = PolyLine(Vertices=merge, Closed=False)  # disabled
ccx = CurveCurve(CurveA=crv, CurveB=rotate.Geometry)  # -> Points, ParamsA, ParamsB; disabled
lng_2 = ListLength(List=ccx.ParamsA)  # disabled
panel_2 = Panel("0")  # disabled
equals = Equality(FirstNumber=lng_2, SecondNumber=panel_2)  # -> Equality, Inequality; disabled
panel_3 = Panel("1")  # disabled
cull = CullPattern(List=graft(rotate.Geometry), CullPattern=equals.Equality)  # disabled
trim = TrimTree(Tree=cull, Depth=1)  # disabled
clean = CleanTree(RemoveNulls=True, RemoveInvalid=True, RemoveEmpty=False, Tree=trim)  # disabled
prune = PruneTree(Tree=clean, Minimum=panel_3, Maximum=0)  # disabled
long = LongestList(ListA=crv_3, ListB=prune, PaddingMode=2)  # -> ListA, ListB; disabled
panel_4 = Panel(clean)  # disabled
merge_2 = Merge(Data1=graft(long.ListA), Data2=graft(long.ListB))  # disabled
number_slider_6 = Slider(0, range=0..100)  # disabled
end_3 = EndPoints(Curve=merge_2)  # -> Start, End; disabled
hull = ConvexHull(Points=[end_3.Start, end_3.End], Plane=PlaneXY(0, 0, 0))  # -> Hull, HullZ, Indices; disabled
getbranch = GetBranch(Tree=hull.Hull, Index=number_slider_6)  # disabled
area = Area(Geometry=hull.Hull)  # -> Area, Centroid; disabled
trim_2 = TrimTree(Tree=area.Area, Depth=1)  # disabled
sort_3 = SortList(Keys=trim_2, ValuesA=prune)  # -> Keys, reverse(ValuesA); disabled
item_4 = ListItem(List=sort_3.ValuesA, Index=0, Wrap=True)  # disabled
crv_5 = Curve([item_4, crv_3])  # disabled
